# Grasshopper definition main.gh (Grasshopper 1.0.7)
# plug-ins: Human UI, DynaModel_v2

button = CreateButton(ButtonName="Save", ButtonStyle=0)
button_2 = CreateButton(ButtonName="Clear", ButtonStyle=0)
thickness = Slider(1, range=0.005..2)
size = Slider(1, range=0.005..2)
panel = Panel("Step 1: Create a cutter to cut the model into two part: main model and end effector")
merge = Merge(Data1=button, Data2=button_2)
separator = CreateSeparator(Thickness=0.5, Horizontal=True, Color=RGB(0, 0, 0))
true_button = CreateTrueOnlyButton(ButtonName="Car", ButtonStyle=0)
adjustpos = AdjustElementPositioning(
    ElementsToAdjust=true_button,
    Margin=Slider(20, range=0..100),
    AbsolutePositioning=False,
    Width=Slider(140, range=0..1000))
stack = CreateStack(UIElements=merge, Horizontal=True)
adjustpos_2 = AdjustElementPositioning(
    ElementsToAdjust=button_2,
    Margin=Slider(20, range=0..100),
    AbsolutePositioning=False,
    Width=Slider(140, range=0..1000),
    Height=Slider(30, range=0..100))
button_3 = CreateButton(ButtonName="Create", ButtonStyle=0)
separator_2 = CreateSeparator(Thickness=0.5, Horizontal=True, Color=RGB(0, 0, 0))
adjustpos_3 = AdjustElementPositioning(
    ElementsToAdjust=button,
    Margin=Slider(20, range=0..100),
    AbsolutePositioning=False,
    Width=Slider(140, range=0..1000),
    Height=Slider(30, range=0..100))
tb = CreateTextBlock(Text="Step 2: Scale the cutter", TextSize=12, Justification=0)
slider = CreateSlider(Slider=size, ShowBounds=False, ShowTicks=False, ShowTooltip=False, ShowValLabel=True, showLabel=True)
separator_3 = CreateSeparator(Thickness=0.5, Horizontal=True, Color=RGB(0, 0, 0))
slider_2 = CreateSlider(Slider=thickness, ShowBounds=False, ShowTicks=False, ShowTooltip=False, ShowValLabel=True, showLabel=True)
button_4 = CreateButton(ButtonName="Clear", ButtonStyle=0)
button_5 = CreateButton(ButtonName="Choose", ButtonStyle=0)
tb_2 = CreateTextBlock(Text="Step 3: Choose your end effector", TextSize=12, Justification=0)
tb_3 = CreateTextBlock(Text=panel, TextSize=12, Justification=0)
button_6 = CreateButton(ButtonName="Create Cutter", ButtonStyle=0)
separator_4 = CreateSeparator(Thickness=0.5, Horizontal=True, Color=RGB(0, 0, 0))
button_7 = CreateButton(ButtonName="Save", ButtonStyle=0)
adjustpos_4 = AdjustElementPositioning(
    ElementsToAdjust=button_7,
    Margin=Slider(20, range=0..100),
    AbsolutePositioning=False,
    Width=Slider(140, range=0..1000),
    Height=Slider(30, range=0..100))
values = ValueListener(Elements=true_button, SomeProperty=True)  # -> Values, Indices
adjustpos_5 = AdjustElementPositioning(
    ElementsToAdjust=button_4,
    Margin=Slider(20, range=0..100),
    AbsolutePositioning=False,
    Width=Slider(140, range=0..1000),
    Height=Slider(30, range=0..100))
values_2 = ValueListener(Elements=button_2, SomeProperty=True)  # -> Values, Indices
values_3 = ValueListener(Elements=button_4, SomeProperty=True)  # -> Values, Indices
values_4 = ValueListener(Elements=button, SomeProperty=True)  # -> Values, Indices
values_5 = ValueListener(Elements=slider_2, SomeProperty=True)  # -> Values, Indices
values_6 = ValueListener(Elements=slider, SomeProperty=True)  # -> Values, Indices
values_7 = ValueListener(Elements=button_7, SomeProperty=True)  # -> Values, Indices
values_8 = ValueListener(Elements=button_6, SomeProperty=True)  # -> Values, Indices
launchwin = LaunchWindow(Show=values.Values, Name="Car", Width=370, Height=400, ChildStatus=0, EnableHorizScroll=False)
tb_4 = CreateTextBlock(Text="Step 1: Press Button To Start", TextSize=12, Justification=0)
merge_2 = Merge(Data1=button_7, Data2=button_4)  # -> flatten(Result)
values_9 = ValueListener(Elements=button_3, SomeProperty=True)  # -> Values, Indices
values_10 = ValueListener(Elements=button_5, SomeProperty=True)  # -> Values, Indices
separator_5 = CreateSeparator(Thickness=0.5, Horizontal=True, Color=RGB(0, 0, 0))
cancel = Cancel(CancelButton=values_2.Values)
cancel_2 = Cancel(CancelButton=values_3.Values)
stack_2 = CreateStack(UIElements=merge_2, Horizontal=Toggle(True))
createcarwheelaxis = CreateCarWheelAxis(StartButton=values_9.Values)
save = Save(SaveButton=values_4.Values, Item=createcarwheelaxis)
merge_3 = Merge(Data1=tb_4, Data2=button_3, Data3=separator_5, Data4=stack)
addelems = AddElements(Window=launchwin, Elements=flatten(merge_3), DoVLChecking=True)  # -> AddedElements, ElementNames
tbvc_for_translational = TrueOnlyButtonValueController_Translational(TrueButtonValue=values_8.Values)
createcutter = CreateCutter(StartButton=tbvc_for_translational)
scale = ScaleCutter(Essentials=createcutter, ScaleFactor=values_6.Values, Thickness=values_5.Values)
saved = SavedItems()
radiobtn = CreateRadioButton(RadioButtonName="Slow", RadioButtonGroup="Gear Speed Group", InitiallySelected=False)
radiobtn_2 = CreateRadioButton(RadioButtonName="Normal", RadioButtonGroup="Gear Speed Group", InitiallySelected=Toggle(True))
radiobtn_3 = CreateRadioButton(RadioButtonName="Fast", RadioButtonGroup="Gear Speed Group", InitiallySelected=False)
values_11 = ValueListener(Elements=radiobtn_2, SomeProperty=True)  # -> Values, Indices
values_12 = ValueListener(Elements=radiobtn, SomeProperty=True)  # -> Values, Indices
values_13 = ValueListener(Elements=radiobtn_3, SomeProperty=True)  # -> Values, Indices
panel_2 = Panel(saved)
button_8 = CreateButton(ButtonName="Delete All", ButtonStyle=0)
merge_4 = Merge(Data1=radiobtn, Data2=radiobtn_2, Data3=radiobtn_3)  # -> flatten(Result)
radiolistener = RadioButtonListener(Slow=values_12.Values, Normal=values_11.Values, Fast=values_13.Values)
endeffector = ChooseEndEffector(Button=values_10.Values, Essentials=scale, GearSpeed=radiolistener)  # -> ResetButtonValue, SavedItem
save_2 = Save(SaveButton=values_7.Values, Item=endeffector.SavedItem)
adjustpos_6 = AdjustElementPositioning(ElementsToAdjust=button_8, AbsolutePositioning=False, Width=Slider(75, range=0..100), Height=Slider(29, range=0..100))
listbox = CreateListBox(ListItems=flatten(panel_2), SelectedIndex=0, Height=100)
stack_3 = CreateStack(UIElements=merge_4, Horizontal=True)
merge_5 = Merge(
    Data1=tb_3,
    Data2=button_6,
    Data3=separator_4,
    Data4=tb,
    Data5=slider,
    Data6=slider_2,
    Data7=separator_2,
    Data8=tb_2,
    Data9=stack_3,
    Data10=button_5,
    Data11=separator_3,
    Data12=stack_2)
label = CreateLabel(LabelText="Saved Items", LabelSize=12, Justification=0)
values_14 = ValueListener(Elements=button_8, SomeProperty=True)  # -> Values, Indices
values_15 = ValueListener(Elements=listbox, SomeProperty=True)  # -> Values, Indices
merge_6 = Merge(Data1=label, Data2=listbox, Data3=button_8)  # -> flatten(Result)
panel_3 = Panel(values_14.Values)
deleteitem = DeleteItem(DeleteButton=values_14.Values, Item=values_15.Values)
panel_4 = Panel(values_15.Values)
viewbox = CreateViewBox(UIElements=merge_6, Width=Slider(80, range=0..1000), Height=Slider(200, range=0..1000))
merge_7 = Merge(Data1=true_button)  # -> flatten(Result)
stack_4 = CreateStack(UIElements=merge_7, Horizontal=Toggle(True))
separator_6 = CreateSeparator(Thickness=0.5, Horizontal=True, Color=RGB(0, 0, 0))
button_9 = CreateButton(ButtonName="Generate All", ButtonStyle=0)
button_10 = CreateButton(ButtonName="Cancel", ButtonStyle=0)
button_11 = CreateButton(ButtonName="Create model for 3D printer", ButtonStyle=0)
launchwin_2 = LaunchWindow(
    Show=Toggle(True),
    Name="DynaModel",
    Width=Slider(380, range=0..1000),
    Height=400,
    ChildStatus=0,
    EnableHorizScroll=False)

# ---- group: Button
separator_7 = CreateSeparator(Thickness=0.5, Horizontal=True, Color=RGB(0, 0, 0))
button_12 = CreateButton(ButtonName="Save", ButtonStyle=0)
button_13 = CreateButton(ButtonName="Clear", ButtonStyle=0)
true_button_2 = CreateTrueOnlyButton(ButtonName="Button", ButtonStyle=0)
tb_5 = CreateTextBlock(Text="Step 1: Press the button to create", TextSize=12, Justification=0)
adjustpos_7 = AdjustElementPositioning(
    ElementsToAdjust=true_button_2,
    Margin=Slider(20, range=0..100),
    AbsolutePositioning=False,
    Width=Slider(140, range=0..1000))
merge_8 = Merge(Data1=button_12, Data2=button_13)
button_14 = CreateButton(ButtonName="Create", ButtonStyle=0)
values_16 = ValueListener(Elements=true_button_2, SomeProperty=True)  # -> Values, Indices
stack_5 = CreateStack(UIElements=merge_8, Horizontal=True)
adjustpos_8 = AdjustElementPositioning(
    ElementsToAdjust=button_13,
    Margin=Slider(20, range=0..100),
    AbsolutePositioning=False,
    Width=Slider(140, range=0..1000),
    Height=Slider(30, range=0..100))
adjustpos_9 = AdjustElementPositioning(
    ElementsToAdjust=button_12,
    Margin=Slider(20, range=0..100),
    AbsolutePositioning=False,
    Width=Slider(140, range=0..1000),
    Height=Slider(30, range=0..100))
launchwin_3 = LaunchWindow(Show=values_16.Values, Name="Button", Width=370, Height=400, ChildStatus=0, EnableHorizScroll=False)
merge_9 = Merge(Data4=tb_5, Data5=button_14, Data6=separator_7, Data7=stack_5)
childwin = MakeChildWindow(ParentWindow=launchwin_2, ChildWindow=launchwin_3)
addelems_2 = AddElements(Window=launchwin_3, Elements=flatten(merge_9), DoVLChecking=True)  # -> AddedElements, ElementNames

# ---- group: Touch
separator_8 = CreateSeparator(Thickness=0.5, Horizontal=True, Color=RGB(0, 0, 0))
button_15 = CreateButton(ButtonName="Save", ButtonStyle=0)
button_16 = CreateButton(ButtonName="Clear", ButtonStyle=0)
true_button_3 = CreateTrueOnlyButton(ButtonName="Touch", ButtonStyle=0)
tb_6 = CreateTextBlock(Text="Step 1: Press the button to create", TextSize=12, Justification=0)
adjustpos_10 = AdjustElementPositioning(
    ElementsToAdjust=true_button_3,
    Margin=Slider(20, range=0..100),
    AbsolutePositioning=False,
    Width=Slider(140, range=0..1000))
merge_10 = Merge(Data1=button_15, Data2=button_16)
button_17 = CreateButton(ButtonName="Create", ButtonStyle=0)
values_17 = ValueListener(Elements=true_button_3, SomeProperty=True)  # -> Values, Indices
stack_6 = CreateStack(UIElements=merge_10, Horizontal=True)
adjustpos_11 = AdjustElementPositioning(
    ElementsToAdjust=button_16,
    Margin=Slider(20, range=0..100),
    AbsolutePositioning=False,
    Width=Slider(140, range=0..1000),
    Height=Slider(30, range=0..100))
adjustpos_12 = AdjustElementPositioning(
    ElementsToAdjust=button_15,
    Margin=Slider(20, range=0..100),
    AbsolutePositioning=False,
    Width=Slider(140, range=0..1000),
    Height=Slider(30, range=0..100))
values_18 = ValueListener(Elements=button_17, SomeProperty=True)  # -> Values, Indices
values_19 = ValueListener(Elements=button_16, SomeProperty=True)  # -> Values, Indices
merge_11 = Merge(Data4=tb_6, Data5=button_17, Data6=separator_8, Data7=stack_6)
values_20 = ValueListener(Elements=button_15, SomeProperty=True)  # -> Values, Indices
launchwin_4 = LaunchWindow(Show=values_17.Values, Name="Touch", Width=370, Height=400, ChildStatus=0, EnableHorizScroll=False)
values_21 = ValueListener(Elements=button_14, SomeProperty=True)  # -> Values, Indices
values_22 = ValueListener(Elements=button_13, SomeProperty=True)  # -> Values, Indices
values_23 = ValueListener(Elements=button_12, SomeProperty=True)  # -> Values, Indices
cancel_3 = Cancel(CancelButton=values_19.Values)
createsimpletouch = CreateSimpleTouch(StartButton=values_18.Values)
childwin_2 = MakeChildWindow(ParentWindow=launchwin_2, ChildWindow=launchwin_4)
cancel_4 = Cancel(CancelButton=values_22.Values)
save_3 = Save(SaveButton=values_20.Values, Item=createsimpletouch)
addelems_3 = AddElements(Window=launchwin_4, Elements=flatten(merge_11), DoVLChecking=True)  # -> AddedElements, ElementNames
createsimplebutton = CreateSimpleButton(StartButton=values_21.Values)
save_4 = Save(SaveButton=values_23.Values, Item=createsimplebutton)

# ---- group: Air Pipe
panel_5 = Panel("Step 1: Press the button to create a air pipe to detect humidity and temperature")
separator_9 = CreateSeparator(Thickness=0.5, Horizontal=True, Color=RGB(0, 0, 0))
true_button_4 = CreateTrueOnlyButton(ButtonName="Air Pipe", ButtonStyle=0)
button_18 = CreateButton(ButtonName="Save", ButtonStyle=0)
button_19 = CreateButton(ButtonName="Clear", ButtonStyle=0)
adjustpos_13 = AdjustElementPositioning(
    ElementsToAdjust=true_button_4,
    Margin=Slider(20, range=0..100),
    AbsolutePositioning=False,
    Width=Slider(140, range=0..1000))
button_20 = CreateButton(ButtonName="Create", ButtonStyle=0)
tb_7 = CreateTextBlock(Text=panel_5, TextSize=12, Justification=0)
values_24 = ValueListener(Elements=true_button_4, SomeProperty=True)  # -> Values, Indices
merge_12 = Merge(Data1=button_18, Data2=button_19)
launchwin_5 = LaunchWindow(Show=values_24.Values, Name="Air Pipe", Width=370, Height=400, ChildStatus=0, EnableHorizScroll=False)
values_25 = ValueListener(Elements=button_20, SomeProperty=True)  # -> Values, Indices
stack_7 = CreateStack(UIElements=merge_12, Horizontal=True)
adjustpos_14 = AdjustElementPositioning(
    ElementsToAdjust=button_19,
    Margin=Slider(20, range=0..100),
    AbsolutePositioning=False,
    Width=Slider(140, range=0..1000),
    Height=Slider(30, range=0..100))
adjustpos_15 = AdjustElementPositioning(
    ElementsToAdjust=button_18,
    Margin=Slider(20, range=0..100),
    AbsolutePositioning=False,
    Width=Slider(140, range=0..1000),
    Height=Slider(30, range=0..100))
createsimplepipe = CreateSimplePipe(StartButton=values_25.Values, InputType="NA", OutputType="Air Pipe")
values_26 = ValueListener(Elements=button_19, SomeProperty=True)  # -> Values, Indices
values_27 = ValueListener(Elements=button_18, SomeProperty=True)  # -> Values, Indices
childwin_3 = MakeChildWindow(ParentWindow=launchwin_2, ChildWindow=launchwin_5)
merge_13 = Merge(Data1=tb_7, Data2=button_20, Data3=separator_9, Data4=stack_7)
addelems_4 = AddElements(Window=launchwin_5, Elements=flatten(merge_13), DoVLChecking=True)  # -> AddedElements, ElementNames
save_5 = Save(SaveButton=values_27.Values, Item=createsimplepipe)
cancel_5 = Cancel(CancelButton=values_26.Values)

# ---- group: Light
pipe_radius_mm = Slider(3, range=1..6)
true_button_5 = CreateTrueOnlyButton(ButtonName="LED Light", ButtonStyle=0)
adjustpos_16 = AdjustElementPositioning(
    ElementsToAdjust=true_button_5,
    Margin=Slider(20, range=0..100),
    AbsolutePositioning=False,
    Width=Slider(140, range=0..1000))
values_28 = ValueListener(Elements=true_button_5, SomeProperty=True)  # -> Values, Indices
separator_10 = CreateSeparator(Thickness=0.5, Horizontal=True, Color=RGB(0, 0, 0))
separator_11 = CreateSeparator(Thickness=0.5, Horizontal=True, Color=RGB(0, 0, 0))
button_21 = CreateButton(ButtonName="Create", ButtonStyle=0)
tb_8 = CreateTextBlock(Text="Step 2: Design the light outsource and create", TextSize=12, Justification=0)
button_22 = CreateButton(ButtonName="Clear", ButtonStyle=0)
button_23 = CreateButton(ButtonName="Save", ButtonStyle=0)
slider_3 = CreateSlider(Slider=pipe_radius_mm, ShowBounds=False, ShowTicks=False, ShowTooltip=False, ShowValLabel=True, showLabel=True)
adjustpos_17 = AdjustElementPositioning(
    ElementsToAdjust=button_22,
    Margin=Slider(20, range=0..100),
    AbsolutePositioning=False,
    Width=Slider(140, range=0..1000),
    Height=Slider(30, range=0..100))
adjustpos_18 = AdjustElementPositioning(
    ElementsToAdjust=button_23,
    Margin=Slider(20, range=0..100),
    AbsolutePositioning=False,
    Width=Slider(140, range=0..1000),
    Height=Slider(30, range=0..100))
tb_9 = CreateTextBlock(Text="Step 1: Decide the light pipe's parameters", TextSize=12, Justification=0)
launchwin_6 = LaunchWindow(Show=values_28.Values, Name="LED Light", Width=370, Height=400, ChildStatus=0, EnableHorizScroll=False)
values_29 = ValueListener(Elements=button_21, SomeProperty=True)  # -> Values, Indices
values_30 = ValueListener(Elements=button_23, SomeProperty=True)  # -> Values, Indices
values_31 = ValueListener(Elements=button_22, SomeProperty=True)  # -> Values, Indices
merge_14 = Merge(Data1=button_23, Data2=button_22)  # -> flatten(Result)
childwin_4 = MakeChildWindow(ParentWindow=launchwin_2, ChildWindow=launchwin_6)
createpipe = CreatePipe(StartButton=values_29.Values, InputType="NA", OutputType="LED Light")
cancel_6 = Cancel(CancelButton=values_31.Values)
save_6 = Save(SaveButton=values_30.Values, Item=createpipe)
stack_8 = CreateStack(UIElements=merge_14, Horizontal=True)
merge_15 = Merge(Data1=tb_9, Data2=slider_3, Data4=separator_11, Data5=tb_8, Data6=button_21, Data7=separator_10, Data8=stack_8)
addelems_5 = AddElements(Window=launchwin_6, Elements=flatten(merge_15), DoVLChecking=True)  # -> AddedElements, ElementNames

# ----
childwin_5 = MakeChildWindow(ParentWindow=launchwin_2, ChildWindow=launchwin)

# ---- group: Rotational
true_button_6 = CreateTrueOnlyButton(ButtonName="Rotational Motion", ButtonStyle=0)
adjustpos_19 = AdjustElementPositioning(
    ElementsToAdjust=true_button_6,
    Margin=Slider(20, range=0..100),
    AbsolutePositioning=False,
    Width=Slider(140, range=0..1000))
values_32 = ValueListener(Elements=true_button_6, SomeProperty=True)  # -> Values, Indices
launchwin_7 = LaunchWindow(Show=values_32.Values, Name="Rotational Motion", Width=370, Height=400, ChildStatus=0, EnableHorizScroll=False)
childwin_6 = MakeChildWindow(ParentWindow=launchwin_2, ChildWindow=launchwin_7)
thickness_2 = Slider(1, range=0.005..2)
size_2 = Slider(1, range=0.005..2)
panel_6 = Panel("Step 1: Create a cutter to cut the model into two part: main model and end effector")
separator_12 = CreateSeparator(Thickness=0.5, Horizontal=True, Color=RGB(0, 0, 0))
tb_10 = CreateTextBlock(Text="Step 2: Scale the cutter", TextSize=12, Justification=0)
slider_4 = CreateSlider(Slider=size_2, ShowBounds=False, ShowTicks=False, ShowTooltip=False, ShowValLabel=True, showLabel=True)
slider_5 = CreateSlider(Slider=thickness_2, ShowBounds=False, ShowTicks=False, ShowTooltip=False, ShowValLabel=True, showLabel=True)
button_24 = CreateButton(ButtonName="Clear", ButtonStyle=0)
separator_13 = CreateSeparator(Thickness=0.5, Horizontal=True, Color=RGB(0, 0, 0))
button_25 = CreateButton(ButtonName="Choose", ButtonStyle=0)
tb_11 = CreateTextBlock(Text="Step 3: Choose your target initial gear and end effector", TextSize=12, Justification=0)
tb_12 = CreateTextBlock(Text=panel_6, TextSize=12, Justification=0)
button_26 = CreateButton(ButtonName="Create Cutter", ButtonStyle=0)
separator_14 = CreateSeparator(Thickness=0.5, Horizontal=True, Color=RGB(0, 0, 0))
button_27 = CreateButton(ButtonName="Save", ButtonStyle=0)
adjustpos_20 = AdjustElementPositioning(
    ElementsToAdjust=button_27,
    Margin=Slider(20, range=0..100),
    AbsolutePositioning=False,
    Width=Slider(140, range=0..1000),
    Height=Slider(30, range=0..100))
adjustpos_21 = AdjustElementPositioning(
    ElementsToAdjust=button_24,
    Margin=Slider(20, range=0..100),
    AbsolutePositioning=False,
    Width=Slider(140, range=0..1000),
    Height=Slider(30, range=0..100))
values_33 = ValueListener(Elements=button_24, SomeProperty=True)  # -> Values, Indices
values_34 = ValueListener(Elements=slider_5, SomeProperty=True)  # -> Values, Indices
values_35 = ValueListener(Elements=slider_4, SomeProperty=True)  # -> Values, Indices
values_36 = ValueListener(Elements=button_27, SomeProperty=True)  # -> Values, Indices
values_37 = ValueListener(Elements=button_26, SomeProperty=True)  # -> Values, Indices
merge_16 = Merge(Data1=button_27, Data2=button_24)  # -> flatten(Result)
values_38 = ValueListener(Elements=button_25, SomeProperty=True)  # -> Values, Indices
tbvc = TrueButtonValueController(TrueButtonValue=values_37.Values)
cancel_7 = Cancel(CancelButton=values_33.Values)
stack_9 = CreateStack(UIElements=merge_16, Horizontal=Toggle(True))
cutter = CreateCutter(StartButton=tbvc)
scale_2 = ScaleCutter(Essentials=cutter, ScaleFactor=values_35.Values, Thickness=values_34.Values)
radiobtn_4 = CreateRadioButton(RadioButtonName="Slow", RadioButtonGroup="Gear Speed Group", InitiallySelected=False)
radiobtn_5 = CreateRadioButton(RadioButtonName="Normal", RadioButtonGroup="Gear Speed Group", InitiallySelected=Toggle(True))
radiobtn_6 = CreateRadioButton(RadioButtonName="Fast", RadioButtonGroup="Gear Speed Group", InitiallySelected=False)
values_39 = ValueListener(Elements=radiobtn_5, SomeProperty=True)  # -> Values, Indices
values_40 = ValueListener(Elements=radiobtn_4, SomeProperty=True)  # -> Values, Indices
values_41 = ValueListener(Elements=radiobtn_6, SomeProperty=True)  # -> Values, Indices
radiolistener_2 = RadioButtonListener(Slow=values_40.Values, Normal=values_39.Values, Fast=values_41.Values)
endeffector_2 = ChooseEndEffector(Button=values_38.Values, Essentials=scale_2, GearSpeed=radiolistener_2)  # -> ResetButtonValue, SavedItem
save_7 = Save(SaveButton=values_36.Values, Item=endeffector_2.SavedItem)
merge_17 = Merge(Data1=radiobtn_4, Data2=radiobtn_5, Data3=radiobtn_6)  # -> flatten(Result)
stack_10 = CreateStack(UIElements=merge_17, Horizontal=True)
merge_18 = Merge(
    Data1=tb_12,
    Data2=button_26,
    Data3=separator_14,
    Data4=tb_10,
    Data5=slider_4,
    Data6=slider_5,
    Data7=separator_12,
    Data8=tb_11,
    Data9=stack_10,
    Data10=button_25,
    Data11=separator_13,
    Data12=stack_9)
addelems_6 = AddElements(Window=launchwin_7, Elements=flatten(merge_18), DoVLChecking=True)  # -> AddedElements, ElementNames

# ----
merge_19 = Merge(Data1=true_button_2, Data2=true_button_3)  # -> flatten(Result)
stack_11 = CreateStack(UIElements=merge_19, Horizontal=Toggle(True))
merge_20 = Merge(Data1=true_button_5, Data2=true_button_4)  # -> flatten(Result)
stack_12 = CreateStack(UIElements=merge_20, Horizontal=Toggle(True))
merge_21 = Merge(Data1=button_9, Data2=button_10)
stack_13 = CreateStack(UIElements=merge_21, Horizontal=True)
adjustpos_22 = AdjustElementPositioning(
    ElementsToAdjust=button_10,
    Margin=Slider(20, range=0..100),
    AbsolutePositioning=False,
    Width=Slider(140, range=0..1000),
    Height=Slider(30, range=0..100))
adjustpos_23 = AdjustElementPositioning(
    ElementsToAdjust=button_9,
    Margin=Slider(20, range=0..100),
    AbsolutePositioning=False,
    Width=Slider(140, range=0..1000),
    Height=Slider(30, range=0..100))
separator_15 = CreateSeparator(Thickness=0.5, Horizontal=True, Color=RGB(0, 0, 0))
values_42 = ValueListener(Elements=button_9, SomeProperty=True)  # -> Values, Indices
nickname = Generate(GenerateButton=values_42.Values)

# ---- group: Transitional Motion
panel_7 = Panel("Transitional Motion")

# ----
true_button_7 = CreateTrueOnlyButton(ButtonName=panel_7, ButtonStyle=0)

# ---- group: Transitional Motion (continued)
adjustpos_24 = AdjustElementPositioning(
    ElementsToAdjust=true_button_7,
    Margin=Slider(20, range=0..100),
    AbsolutePositioning=False,
    Width=Slider(140, range=0..200))

# ----
values_43 = ValueListener(Elements=true_button_7, SomeProperty=True)  # -> Values, Indices
launchwin_8 = LaunchWindow(Show=values_43.Values, Name="Transitional Motion", Width=370, Height=400, ChildStatus=0, EnableHorizScroll=False)
childwin_7 = MakeChildWindow(ParentWindow=launchwin_2, ChildWindow=launchwin_8)
addelems_7 = AddElements(Window=launchwin_8, Elements=flatten(merge_5), DoVLChecking=True)  # -> AddedElements, ElementNames
merge_22 = Merge(Data1=true_button_6, Data2=true_button_7)  # -> flatten(Result)
stack_14 = CreateStack(UIElements=merge_22, Horizontal=Toggle(True))
merge_23 = Merge(Data1=stack_14, Data2=stack_12, Data4=stack_11, Data5=stack_4)  # -> flatten(Result)
viewbox_2 = CreateViewBox(UIElements=merge_23, Width=Slider(279, range=0..1000), Height=Slider(292, range=0..1000))
merge_24 = Merge(Data1=viewbox, Data2=viewbox_2)  # -> flatten(Result)
stack_15 = CreateStack(UIElements=merge_24, Horizontal=True)
merge_25 = Merge(Data1=stack_15, Data2=separator_15, Data3=stack_13, Data4=separator_6, Data5=button_11)
addelems_8 = AddElements(Window=launchwin_2, Elements=flatten(merge_25), DoVLChecking=True)  # -> AddedElements, ElementNames
